# Grasshopper definition honeybee-ifc.gh (Grasshopper 1.0.7)
# plug-ins: Human

panel = Panel("C:\Users\devan\simulation\SmallOffice_d_IFC2x3.hbjson")
panel_2 = Panel("C:\Users\devan\simulation\BEM_Example_ArchiCAD.hbjson")
loadobjects = HBLoadObjects(hb_file="C:\Users\devan\simulation\FamilyHouse_AC13.hbjson", load=Toggle(True))  # -> report, hb_objs; plug-in component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
vizbytype = HBVisualizeByType(hb_objs=loadobjects.hb_objs)  # -> walls, interior_walls, roofs, ceilings, exterior_floors, interior_floors, air_walls, apertures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; plug-in component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
panel_3 = Panel("""0.80, 6.47, 2.87
0.80, 6.47, 2.87
2.00, 6.47, 2.87
3.20, 6.47, 2.87
0.80, 6.47, 2.87""")
deconstructmodel = HBDeconstructModel(model=loadobjects.hb_objs)  # -> rooms, faces, apertures, doors, shades; plug-in component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
vizquick = HBVizualizeQuick(hb_objs=flatten(deconstructmodel.rooms))  # -> geo; plug-in component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
vizquick_2 = HBVizualizeQuick(hb_objs=flatten(deconstructmodel.shades))  # -> geo; plug-in component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
vizquick_3 = HBVizualizeQuick(hb_objs=flatten(deconstructmodel.apertures))  # -> geo; plug-in component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
vizquick_4 = HBVizualizeQuick(hb_objs=flatten(deconstructmodel.doors))  # -> geo; plug-in component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
wires = BrepWireframe(Brep=[vizquick, vizquick_2], Density=-1)
list = ItemSelector(
    panel_3,
    {"0.80, 6.47, 2.87", "0.80, 6.47, 2.87", "2.00, 6.47, 2.87", "3.20, 6.47, 2.87", "0.80, 6.47, 2.87"}, selected="0.80, 6.47, 2.87")
preview = CustomPreview(Geometry=vizquick_3, Material=ColourSwatch(SwatchColor=RGB(0, 210, 255)))
preview_2 = CustomPreview(Geometry=vizquick_4, Material=ColourSwatch(SwatchColor=RGB(58, 0, 0)))
facen = FaceNormals(Mesh=vizquick_3)  # -> Centers, Normals
facen_2 = FaceNormals(Mesh=vizquick_4)  # -> Centers, Normals
pt = Point(panel_3)
vdis = VectorDisplay(Anchor=facen.Centers, Vector=facen.Normals)
vdis_2 = VectorDisplay(Anchor=facen_2.Centers, Vector=facen_2.Normals)
pt_2 = Point(list)
